# Grasshopper definition ShelterOptimizationPrototype.gh (Grasshopper 1.0.7)
# plug-ins: LunchBox

# ---- group: design parameters
demo_index = Slider(1, range=0..2)
demospaces = Surface([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])
item = ListItem(List=demospaces, Index=demo_index, Wrap=True)
inputspace = Surface(item)
number_slider = Slider(12.035, range=11.8..20)
middlecirculationwidth = Slider(4, range=0..10)
endcirculationwidth = Slider(4, range=0..10)
vorh = Slider(0, range=0..1)
spaces_with_single_circulation = Panel("""0
-1""")

# ---- group: COVID geometry rules
boundingbox = Curve(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)
visualization = Curve([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])
boundingbox_2 = Curve(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)
visualization_2 = Curve([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])
boundingbox_3 = Curve(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)
boundingbox_4 = Curve(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)
visualization_3 = Curve([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])
visualization_4 = Curve([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])
center = Point(Point(312.8325095, 1052.864969, 0))
center_2 = Point(Point(312.8309449, 1118.586855, 0))
boundingbox_5 = Curve(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)
center_3 = Point(Point(312.4913576, 1086.424833, 0))
center_4 = Point(Point(312.8325095, 1017.763373, 0))
visualization_5 = Curve([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])
boundingbox_6 = Curve(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)
boundingbox_7 = Curve(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)
visualization_6 = Curve([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])
visualization_7 = Curve([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])
center_5 = Point(Point(312.8380605, 980.5347564, 0))
center_6 = Point(Point(313.0918282, 935.6762749, 0))
center_7 = Point(Point(313.0986003, 884.2066155, 0))
boundingbox_8 = Curve(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)
visualization_8 = Curve([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])
center_8 = Point(Point(313.1368286, 829.0601535, 0))
center_points = Merge(
    Data1=center_2,
    Data2=center_3,
    Data3=center,
    Data4=center_4,
    Data5=center_5,
    Data6=center_6,
    Data7=center_7,
    Data8=center_8)
bounding_boxes = Merge(
    Data1=boundingbox_2,
    Data2=boundingbox_3,
    Data3=boundingbox,
    Data4=boundingbox_4,
    Data5=boundingbox_5,
    Data6=boundingbox_6,
    Data7=boundingbox_7,
    Data8=boundingbox_8)
entwine = Entwine(
    Branch00=visualization_2,
    Branch01=visualization_3,
    Branch02=visualization,
    Branch03=visualization_4,
    Branch04=visualization_5,
    Branch05=visualization_6,
    Branch06=visualization_7,
    Branch07=visualization_8,
    FlattenInputs=True)

# ---- group: excel data input
path = FilePath("C:\Users\John Rao\Dropbox (MIT)\MIT_Work\2020SummerRA\URL_Providence\Excel Sheets\Shelter Occupancy Excel Data Test 4.xlsx")
panel = Panel(path)
excelread = ExcelReader(ReadExcelData=Toggle(True), WorkbookPath=path, WorksheetName="Sheet1")  # -> Exceptions, ExcelData
groupdata = Panel(excelread.ExcelData)
str_to_int = GhPythonScript(x=excelread.ExcelData)  # -> out, a; inputs x: list
# ---------- str_to_int: Python ----------
__author__ = "John_Rao"
__version__ = "2021.01.20"

import rhinoscriptsyntax as rs

a = list()
for i in x:
    a.append(int(i))
print(a)
# ---------- end str_to_int ----------
item_2 = ListItem(List=excelread.ExcelData, Index=Slider(9, range=0..100), Wrap=False)
subtraction = Subtraction(A=item_2, B=1)
select_visual = GhPythonScript(x=subtraction)  # -> out, a
# ---------- select_visual: Python ----------
__author__ = "John_Rao"
__version__ = "2021.01.18"

import rhinoscriptsyntax as rs

def select_visual(x):
    mask = '{0;'+ str(x) + "}"
    return mask
a = select_visual(x)
# ---------- end select_visual ----------
pt_from = ListItem(List=center_points, Index=subtraction, Wrap=True)

# ----
bbox_srf = BoundarySurfaces(Edges=bounding_boxes)

# ---- group: space configuration
createdivisionlines = CreateDivisionLines(inputpolygon=inputspace, divisiondistance=number_slider)  # -> verticaldivisions, horizontaldivisions
crv = Curve(createdivisionlines.verticaldivisions)
crv_2 = Curve(createdivisionlines.horizontaldivisions)
entwine_2 = Entwine(Branch00=crv, Branch01=crv_2, FlattenInputs=True)
expression = Expression(x=vorh, V="{0;0}", H="{0;1}", Expression="If(x=0, V, H)")
split = SplitTree(Data=entwine_2, Masks=flatten(expression))  # -> Positive, Negative
lineforcirculation = CullIndex(List=split.Positive, Indices=spaces_with_single_circulation, Wrap=True)
circulation = Circulation(S=inputspace, line=lineforcirculation, circulationwidth=middlecirculationwidth, addcirculationwidth=endcirculationwidth)  # -> circulation, occupiable
srf = Surface(circulation.occupiable)
srf_2 = Surface(circulation.circulation)
compute_centerline = Compute_centerline(B=srf)
end = EndPoints(Curve=compute_centerline)  # -> Start, End
pt = Point(end.Start)
pt_2 = Point(end.End)
sorting_space = Sorting_space(d=vorh, d1=pt, d2=pt_2, line=compute_centerline)  # -> capacities, start_pt_2, end_pt_2
panel_2 = Panel(sorting_space.capacities)

# ----
dim = Dimensions(Surface=bbox_srf)  # -> UDimension, VDimension
panel_3 = Panel(dim.VDimension)
item_3 = ListItem(List=dim.VDimension, Index=subtraction, Wrap=True)
panel_4 = Panel(item_3)

# ---- group: Run?
computemapping = BooleanToggle(False)
visualize = BooleanToggle(False)

# ---- group: output
mapping = GhPythonScript(compute=computemapping, demand=str_to_int.a, occupiable_dim=sorting_space.capacities, geometry_dim=dim.VDimension)  # -> out, total_peoplePlaced, total_peopleUnplaced, groupType_unplaced, groupIndex_unplaced, group_placements, space_groupType, mapped_data; inputs demand: list, occupiable_dim: list, geometry_dim: list
# ---------- mapping: Python ----------
__author__ = "John_Rao"
__version__ = "2021.01.18"

import rhinoscriptsyntax as rs
import copy

def construct_data(occupiable_dim, demand, geometry_dim):
    geometry_dim.sort()
    shelters = []
    spaces = []
    for i in range(len(demand)):
        #shelters.append({'W': round(geometry_dim[demand[i] - 1]), "V": round(demand[i]), "space": None})
        shelters.append({'index': i, 'W': geometry_dim[demand[i] - 1], "V": demand[i], "space": None})
    for i in range(len(occupiable_dim)):
        #spaces.append({"W": round(occupiable_dim[i]), "V": 0, 'placed': []})
        spaces.append({'index': i, "W": occupiable_dim[i], "V": 0, 'placed': None})
            
    data = {"shelter": shelters, "space": spaces}
    return data
    
def total_placed(data):
    total = 0
    for i in data['space']:
        total += i['V']
    return total

#current data structure records that index of the shelter space that is 
#convert the mapping of index to mapping of group geometries in a nested list
def indexMapping_to_geoMapping(data, demand):
    mapping = []
    for i in data['space']:
        current = []
        for j in i['placed']:
            current.append(demand[j])
        i['placed_type'] = current

def maximize(data, demand): 
    #a naive recursive function solving 01 knapsack (handles non-integer dimensions)
    def naive(C, wt, val, n):
        if n == 0 or C == 0:
            ans = 0
            tracker[(C, n)] = ans
            return ans
        if wt[n-1][1] > C:
            ans = naive(C, wt, val, n-1)
            tracker[(C, n)] = ans
            return ans
        else:
            ans = max(val[n-1][1] + naive(C-wt[n-1][1], wt, val, n-1), naive(C, wt, val, n-1))            
            tracker[(C, n)] = ans
            return ans

    #iterate through all occupiable space and optimize each one individually with naive or DP function
    #remaining = data['shelter'].copy()
    remaining = []
    for d in data['shelter']:
        remaining.append(d)
    mapping = []
    for i in data['space']:
        C = i['W']
        wt = []
        val = []
        tracker = dict()
        for j in remaining:
            #adding each shelter item as a tuple (original index in demand list, W or V)
            wt.append((j['index'], j['W']))
            val.append((j['index'], j['V']))
        n = len(val)
        n_placed = naive(C, wt, val, n)

        #work backwards looking for the items that were placed
        N = n
        c = C
        curr_ans = tracker[(c, N)]
        #print(curr_ans)
        #print(n_placed)
        placed_list = []
        while N > 0:
            if (N == 1 or curr_ans != tracker[c, N - 1]) and wt[N - 1][1] <= c:
                remaining.pop(N-1)
                #print(remaining)
                placed_list.append(wt[N - 1][0])
                c -= wt[N - 1][1]
                curr_ans -= val[N - 1][1]
            N -= 1
        '''check_w = 0
        for i in placed_list:
            check_w += data['shelter'][i]['W']
        check_v = 0
        for i in placed_list:
            check_v += demand[i]
        print(check_w, check_v)'''
        mapping.append([n_placed, placed_list])

        i['V'] += n_placed
        i['placed'] = placed_list
        for k in placed_list:
            data['shelter'][k]['space'] = i['index']

    indexMapping_to_geoMapping(data, demand)
    return data

#driver 
if compute == True:
    d = demand
    o_d = occupiable_dim
    g_d = geometry_dim
    #print(d)
    #print(o_d)
    #print(g_d)
    data = construct_data(o_d, d, g_d)
    result = maximize(data, d)
    s_to_sp = []
    for s in result['shelter']:
        s_to_sp.append(s['space'])
    group_placements = s_to_sp
    total_peoplePlaced = total_placed(data)
    space_groupT = []
    for g in result['space']:
        space_groupT.append(g['placed_type'])
    space_groupType = space_groupT
    groupIndex_unplaced = []
    total_peopleUnplaced = 0
    groupType_unplaced = {}
    for g in result['shelter']:
        if g['space'] == None:
            groupIndex_unplaced.append(g['index'])
            total_peopleUnplaced += g['V']
            if g['V'] not in groupType_unplaced.keys():
                groupType_unplaced[g['V']] = 1
            else:
                groupType_unplaced[g['V']] += 1
    mapped_data = result
    print(groupType_unplaced)
# ---------- end mapping ----------
groupindex_placements = Panel(mapping.group_placements)
total_people_placed = Panel(mapping.total_peoplePlaced)
nl_to_tree = GhPythonScript(nl=mapping.space_groupType)  # -> out, data; inputs nl: list
# ---------- nl_to_tree: Python ----------
__author__ = "John_Rao"
__version__ = "2021.01.20"

import rhinoscriptsyntax as rs
import Rhino.Geometry as rg
from clr import AddReference as addr
addr('Grasshopper')

from System import Object
from Grasshopper import DataTree
from Grasshopper.Kernel.Data import GH_Path

def nestedList_to_tree(nestedlist):
    nl = nestedList
    tree = DataTree[object]()
    for i in range(len(nl)):
        temp = []
        for j in range(len(nl[i])):
            temp.append(nl[i][j])
        path = GH_Path(i)
        tree.AddRange(temp, path)
        
    return tree

nestedList = nl
data = nestedList_to_tree(nestedList)
print(data)
# ---------- end nl_to_tree ----------
spaceindex_placedtype = Panel(nl_to_tree.data)
groupindex_unplaced = Panel(mapping.groupIndex_unplaced)
total_people_unplaced = Panel(mapping.total_peopleUnplaced)
grouptype_unplaced = Panel(mapping.out)

# ---- group: output visualization
centerline_start = Point(sorting_space.start_pt_2)
origin_pt = Point(center_points)
vorh_2 = Number(vorh)
visualize_2 = GhPythonScript(
    compute=visualize,
    direction=vorh_2,
    centerline_pt=flatten(centerline_start),
    geo_dim=dim.VDimension,
    geo_centers=origin_pt,
    mapping=nl_to_tree.data,
    geo=entwine)  # -> out, vis_data; inputs centerline_pt: list, geo_dim: list, geo_centers: list, mapping: tree, geo: tree
# ---------- visualize_2: Python ----------
__author__ = "John_Rao"
__version__ = "2021.01.20"

import rhinoscriptsyntax as rs
import Rhino.Geometry as rg
import scriptcontext as sc
import System.Object as so
from clr import AddReference as addr
addr('Grasshopper')

#from System import Object
from Grasshopper import DataTree
from Grasshopper.Kernel.Data import GH_Path

def pairing(mapping, geo, centers, line_pt):
    pairs = []
    for i in range(mapping.BranchCount):
        #print(mapping.BranchCount)
        curr_pair = []
        branchList = mapping.Branch(i)
        for j in branchList:
            dest = rs.coerce3dpoint(line_pt[i])
            group_type = j
            og = rs.coerce3dpoint(centers[j - 1])
            #g = geo[j - 1]
            g = geo.Branch(j - 1)
            curr_pair.append([group_type, og, dest, g])
        pairs.append(curr_pair)
    return pairs

def move_dest_pt(paired, geo_dim, direction):
    #iterate through each space (sp)
    for sp in paired:
        #iterate through each group in sp
        for i in range(len(sp)):
           group_type = sp[i][0]
           offset_dis = geo_dim[group_type - 1] / 2
           point = sp[i][2]
           #print(point.X, point.Y, point.Z)
           if direction == 0:
               point.Y = point.Y + offset_dis
               if i != len(sp) - 1:
                   sp[i + 1][2].Y = point.Y + offset_dis
           elif direction == 1:
               point.X = point.X + offset_dis
               if i != len(sp) - 1:
                   sp[i + 1][2].X = point.X + offset_dis
           #print(point.X, point.Y, point.Z)
           
    return paired
           
def move_geo(paired, dir):
    vis_list = []
    for sp in paired:
        for gr in sp:
            vec = rs.VectorCreate(gr[2], gr[1])
            for v in gr[3]:
                geo = rs.CopyObject(v, vec)
                if dir == 1:
                    rs.RotateObject(geo, gr[2], 90, [0, 0, 1])
                vis_list.append(geo)
    return vis_list
    
#driver code
if compute:
    vis_pair = pairing(mapping, geo, geo_centers, centerline_pt)
    vis_data= move_geo(move_dest_pt(vis_pair, geo_dim, direction), direction)
#print(vis_data)
# ---------- end visualize_2 ----------
visualization_9 = Geometry(visualize_2.vis_data)

# ==== cluster CreateDivisionLines
divisiondistance = ClusterInput()
inputpolygon = ClusterInput()
debrep = DeconstructBrep(InputPolygon=inputpolygon)  # -> Faces, Edges, Vertices
item = ListItem(List=debrep.Edges, Index=0, Wrap=True)  # -> Item, Item1, Item2, Item3
crv = Curve(item.Item2)
crv_2 = Curve(item.Item)
crv_3 = Curve(item.Item1)
crv_4 = Curve(item.Item3)
len = Length(Curve=crv_2)
len_2 = Length(Curve=crv_3)
division = Division(A=len, DivisionDistance=divisiondistance)
division_2 = Division(A=len_2, B=divisiondistance)
round = Round(Number=division)  # -> Nearest, Floor, Ceiling
round_2 = Round(Number=division_2)  # -> Nearest, Floor, Ceiling
divide = DivideCurve(Curve=crv_2, Count=round.Nearest, Kinks=False)  # -> Points, Tangents, Parameters
divide_2 = DivideCurve(Curve=crv, Count=round.Nearest, Kinks=False)  # -> Points, Tangents, Parameters
divide_3 = DivideCurve(Curve=crv_3, Count=round_2.Nearest, Kinks=False)  # -> Points, Tangents, Parameters
divide_4 = DivideCurve(Curve=crv_4, Count=round_2.Nearest, Kinks=False)  # -> Points, Tangents, Parameters
sort_pt = SortPoints(Points=divide.Points)  # -> Points, Indices
sort_pt_2 = SortPoints(Points=divide_2.Points)  # -> Points, Indices
sort_pt_3 = SortPoints(Points=divide_3.Points)  # -> Points, Indices
sort_pt_4 = SortPoints(Points=divide_4.Points)  # -> Points, Indices
ln = Line(StartPoint=sort_pt.Points, EndPoint=sort_pt_2.Points)
ln_2 = Line(StartPoint=sort_pt_3.Points, EndPoint=sort_pt_4.Points)
verticaldivisions = ClusterOutput(ln)
horizontaldivisions = ClusterOutput(ln_2)

# ==== cluster Circulation
circulationwidth = ClusterInput()
addcirculationwidth = ClusterInput()
line = ClusterInput()
division = Division(CirculationWidth=circulationwidth, B=2)
neg = Negative(Value=division)
offset = OffsetCurve(Curve=line, Distance=neg, Plane=PlaneXY(0, 0, 0), Corners=1)
offset_2 = OffsetCurve(Curve=line, Distance=division, Plane=PlaneXY(0, 0, 0), Corners=1)
cull_i = CullIndex(List=flatten(offset_2), Indices="-1", Wrap=True)
cull_i_2 = CullIndex(List=flatten(offset), Indices="0", Wrap=True)
end = EndPoints(Curve=cull_i)  # -> Start, End
end_2 = EndPoints(Curve=cull_i_2)  # -> Start, End
neg_2 = Negative(AddCirculationWidth=addcirculationwidth)
ln = Line(StartPoint=end.Start, EndPoint=end_2.Start)
ln_2 = Line(StartPoint=end.End, EndPoint=end_2.End)
offset_3 = OffsetCurve(Curve=ln, AddCirculationWidth=neg_2, Plane=PlaneXY(0, 0, 0), Corners=1)
offset_4 = OffsetCurve(Curve=ln_2, AddCirculationWidth=addcirculationwidth, Plane=PlaneXY(0, 0, 0), Corners=1)
merge = Merge(Data1=offset_3, Data2=offset_4, Data3=offset_2, Data4=offset)
S = ClusterInput()
srfsplit = SurfaceSplit(Surface=S, Curves=flatten(merge))
shrinktrimsrf = ShrinkTrimmedSurface(Surface=srfsplit)  # -> Shrunken, Underlying, R
dim = Dimensions(Surface=shrinktrimsrf.Shrunken)  # -> UDimension, VDimension
equalst = EqualityWithinTolerance(FirstNumber=dim.VDimension, AddCirculationWidth=addcirculationwidth, Tolerance=0.01)  # -> Equality, Inequality
equalst_2 = EqualityWithinTolerance(FirstNumber=dim.UDimension, AddCirculationWidth=addcirculationwidth, Tolerance=0.01)  # -> Equality, Inequality
equalst_3 = EqualityWithinTolerance(FirstNumber=dim.VDimension, CirculationWidth=circulationwidth, Tolerance=0.01)  # -> Equality, Inequality
equalst_4 = EqualityWithinTolerance(FirstNumber=dim.UDimension, CirculationWidth=circulationwidth, Tolerance=0.01)  # -> Equality, Inequality
dispatch = Dispatch(List=shrinktrimsrf.Shrunken, DispatchPattern=equalst_3.Equality)  # -> ListA, ListB
dispatch_2 = Dispatch(List=shrinktrimsrf.Shrunken, DispatchPattern=equalst_4.Equality)  # -> ListA, ListB
dispatch_3 = Dispatch(List=shrinktrimsrf.Shrunken, DispatchPattern=equalst.Equality)  # -> ListA, ListB
dispatch_4 = Dispatch(List=shrinktrimsrf.Shrunken, DispatchPattern=equalst_2.Equality)  # -> ListA, ListB
srf = Surface(dispatch_2.ListA)
srf_2 = Surface(dispatch.ListA)
srf_3 = Surface(dispatch_3.ListA)
srf_4 = Surface(dispatch_4.ListA)
merge_2 = Merge(Data1=srf_2, Data2=srf, Data3=srf_3, Data4=srf_4)
index = ItemIndex(List=shrinktrimsrf.Shrunken, Item=[dispatch.ListA, dispatch_2.ListA, dispatch_3.ListA, dispatch_4.ListA])
cull_i_3 = CullIndex(List=shrinktrimsrf.Shrunken, Indices=index, Wrap=True)
occupiable = ClusterOutput(cull_i_3)
circulation = ClusterOutput(merge_2)

# ==== cluster Compute_centerline
B = ClusterInput()
occupiable = DeconstructBrep(Brep=B)  # -> Faces, Edges, Vertices
join = JoinCurves(Curves=occupiable.Edges, Preserve=False)
explode = Explode(Curve=join, Recursive=True)  # -> Segments, Vertices
len = Length(Curve=explode.Segments)
sort = SortList(Keys=len, ValuesA=explode.Segments)  # -> Keys, ValuesA
item = ListItem(List=sort.ValuesA, Index=0, Wrap=True)  # -> Item, Item1
eval = EvaluateLength(Curve=item.Item, Length="0.5", Normalized=True)  # -> Point, Tangent, Parameter
eval_2 = EvaluateLength(Curve=item.Item1, Length="0.5", Normalized=True)  # -> Point, Tangent, Parameter
ln = Line(StartPoint=eval.Point, EndPoint=eval_2.Point)
centerline = ClusterOutput(ln)

# ==== cluster Sorting_space
d1 = ClusterInput()
line = ClusterInput()
d2 = ClusterInput()
d = ClusterInput()
merge = Merge(Data1=d1, Data2=d2)  # -> flatten(Result)
pdecon = Deconstruct(Point=d1)  # -> XComponent, YComponent, ZComponent
pdecon_2 = Deconstruct(Point=merge)  # -> XComponent, YComponent, ZComponent
expression = Expression(d=d, x=pdecon.XComponent, y=pdecon.YComponent, Expression="If(d = 0, x, y)")
expression_2 = Expression(d=d, x=pdecon_2.XComponent, y=pdecon_2.YComponent, Expression="If(d = 0, y, x)")
lng = ListLength(List=merge)
sort = SortList(Keys=flatten(expression), ValuesLine=flatten(line))  # -> Keys, ValuesLine
division = Division(A=lng, B=2)
sort_2 = SortList(Keys=flatten(expression_2), ValuesA=flatten(merge))  # -> Keys, ValuesA
capacity = Length(Curve=sort.ValuesLine)
split = SplitList(List=sort_2.ValuesA, Index=division)  # -> ListA, ListB
pdecon_3 = Deconstruct(Point=split.ListA)  # -> XComponent, YComponent, ZComponent
pdecon_4 = Deconstruct(Point=split.ListB)  # -> XComponent, YComponent, ZComponent
expression_3 = Expression(d=d, x=pdecon_3.XComponent, y=pdecon_3.YComponent, Expression="If(d = 0, x, y)")
expression_4 = Expression(d=d, x=pdecon_4.XComponent, y=pdecon_4.YComponent, Expression="If(d = 0, x, y)")
sort_3 = SortList(Keys=flatten(expression_3), ValuesA=flatten(split.ListA))  # -> Keys, ValuesA
capacities = ClusterOutput(capacity)
sort_4 = SortList(Keys=flatten(expression_4), ValuesA=flatten(split.ListB))  # -> Keys, ValuesA
start_pt = Point(sort_3.ValuesA)
end_pt = Point(sort_4.ValuesA)
start_pt_2 = ClusterOutput(start_pt)
end_pt_2 = ClusterOutput(end_pt)
